# Grasshopper definition RozvanyDraw.gh (Grasshopper 1.0.7)
# plug-ins: Kangaroo2 Components, Karamba3D

pipeline = GeometryPipeline(
    GroupByLayer=False,
    GroupByType=False,
    IncludeHidden=True,
    IncludeLocked=True,
    LayerFilter="Clamped boundary",
    NameFilter="*",
    SublayerFiltering=False,
    TypeFilter=4)
pipeline_2 = GeometryPipeline(
    GroupByLayer=False,
    GroupByType=False,
    IncludeHidden=True,
    IncludeLocked=True,
    LayerFilter="Clamped interior",
    NameFilter="*",
    SublayerFiltering=False,
    TypeFilter=1)
pipeline_3 = GeometryPipeline(
    GroupByLayer=False,
    GroupByType=False,
    IncludeHidden=True,
    IncludeLocked=True,
    LayerFilter="Clamped interior",
    NameFilter="*",
    SublayerFiltering=False,
    TypeFilter=4)

boundarypoints = GetPoint(AtLeast=3, AtMost=2147483647, Realtime=True)
intline = GetPoint(AtLeast=0, AtMost=2147483647, Realtime=True)
arcpoints = GetPoint(AtLeast=0, AtMost=3, Realtime=True)
item = ListItem(List=arcpoints, Index=0, Wrap=True)  # -> Item, Item1, Item2
pline = PolyLine(Vertices=intline, Closed=False)  # -> simplify(Polyline)
pline_2 = PolyLine(Vertices=boundarypoints, Closed=invert(False))
colpoints = GetPoint(AtLeast=0, AtMost=2147483647, Realtime=True)
arc = Arc3Pt(PointA=item.Item, PointB=item.Item1, PointC=item.Item2)  # -> simplify(Arc), Plane, Radius
len = Length(Curve=pline)
pt = Point(colpoints)

explode = Explode(Curve=pline_2, Recursive=True)  # -> Segments, Vertices
len_2 = Length(Curve=explode.Segments)

len_3 = Length(Curve=arc.Arc)

spacing = GetNumber(Slider(10, range=10..20), AtLeast=1, AtMost=2147483647, Maximum=1.797693135e+308, Minimum=-1.797693135e+308)

division = Division(A=len_3, B=spacing)
round = Round(Number=division)  # -> Nearest, Floor, Ceiling
divide = DivideCurve(Curve=simplify(graft(arc.Arc)), Count=simplify(graft(round.Nearest)), Kinks=False)  # -> Points, Tangents, Parameters
pline_3 = PolyLine(Vertices=divide.Points, Closed=False)
end = EndPoints(Curve=graft(pline_3))  # -> Start, End
merge = Merge(Data1=end.Start, Data2=end.End)
crv = Curve(pline_3)
pt_2 = Point(merge)
pt_3 = Point(divide.Points)

division_2 = Division(A=len_2, B=spacing)
round_2 = Round(Number=division_2)  # -> Nearest, Floor, Ceiling
divide_2 = DivideCurve(Curve=explode.Segments, Count=round_2.Nearest, Kinks=False)  # -> Points, Tangents, Parameters
pline_4 = PolyLine(Vertices=divide_2.Points, Closed=False)
end_2 = EndPoints(Curve=graft(pline_4))  # -> Start, End
crv_2 = Curve(pline_4)
merge_2 = Merge(Data1=end_2.Start, Data2=end_2.End)
pt_4 = Point(divide_2.Points)
pt_5 = Point(merge_2)

division_3 = Division(A=len, B=spacing)
round_3 = Round(Number=division_3)  # -> Nearest, Floor, Ceiling
divide_3 = DivideCurve(Curve=simplify(graft(pline)), Count=simplify(graft(round_3.Nearest)), Kinks=False)  # -> Points, Tangents, Parameters
pline_5 = PolyLine(Vertices=divide_3.Points, Closed=False)
end_3 = EndPoints(Curve=graft(pline_5))  # -> Start, End
merge_3 = Merge(Data1=end_3.Start, Data2=end_3.End)
crv_3 = Curve(pline_5)
pt_6 = Point(divide_3.Points)
pt_7 = Point(merge_3)
merge_4 = Merge(Data1=pt_6, Data2=pt_3)

entwine = Entwine(Branch0X=simplify(merge_4), Branch1X=simplify(graft(pt)), Branch2X=simplify(pt_4), FlattenInputs=False)

pt_8 = Point(entwine)

voronoi = Voronoi(Points=flatten(pt_8), BruteForceOverride=False)

unflatten = UnflattenTree(Tree=voronoi, Guide=pt_8)
runion = RegionUnion(Curves=unflatten)
trim = TrimWithRegion(Curve=runion, Region=pline_2)  # -> Inside, Outside
merge_5 = Merge(Data1=trim.Inside, Data2=pline_2)

crv_4 = Curve(merge_5)
explode_2 = Explode(Curve=flatten(crv_4), Recursive=True)  # -> Segments, Vertices
dupln = RemoveDuplicateLines(Lines=flatten(explode_2.Segments), Tolerance=Slider(0.005, range=0..0.01))
join = JoinCurves(Curves=dupln, Preserve=False)
mcx = MultipleCurves(Curves=join)  # -> Points, IndexA, IndexB, ParamA, ParamB
Z = UnitZ(Factor=1)
line = LineSDL(Start=mcx.Points, Direction=Z, Length=1)
ccx = CurveCurve(CurveA=graft(crv_4), CurveB=line)  # -> Points, ParamsA, ParamsB
pshift = ShiftPaths(Data=simplify(ccx.ParamsA), Offset=-1)
shatter = Shatter(Curve=graft(crv_4), Parameters=pshift)
eval = EvaluateLength(Curve=flatten(shatter), Length=Slider(0.5, range=0..1), Normalized=True)  # -> Point, Tangent, Parameter
rdpoints = RemoveDuplicatePointsKaramba(Point=eval.Point, LimitDistance=Slider(0.05, range=0..1))  # -> OutPoint, Info, Indexes
cull_i = CullIndex(List=flatten(shatter), Indices=rdpoints.Indexes, Wrap=False)
eval_2 = EvaluateLength(Curve=flatten(cull_i), Length=Slider(0.5, range=0..1), Normalized=True)  # -> Point, Tangent, Parameter

merge_6 = Merge(Data1=cull_i, Data2=pline_3)  # -> flatten(Result)

len_4 = Length(Curve=merge_6)
division_4 = Division(A=len_4, B=spacing)
round_4 = Round(Number=division_4)  # -> Nearest, Floor, Ceiling
divide_4 = DivideCurve(Curve=merge_6, Count=round_4.Nearest, Kinks=False)  # -> Points, Tangents, Parameters

merge_7 = Merge(Data1=divide_4.Points, Data2=pt)
cullpt = CullDuplicates(Points=flatten(merge_7), Tolerance=0.1, CullMode=3)  # -> Points, Indices, Valence
voronoi_2 = Voronoi(Points=flatten(cullpt.Points), BruteForceOverride=False)

trim_2 = TrimWithRegion(Curve=voronoi_2, Region=pline_2)  # -> Inside, Outside
clean = CleanTree(RemoveNulls=True, RemoveInvalid=True, RemoveEmpty=False, Tree=trim_2.Inside)

# ---- group: RH_OUT:curves
crv_5 = Curve(clean)
